# Grasshopper definition LinkedinAPI.gh (Grasshopper 1.0.8)
# plug-ins: RhinoCodePluginGH

# paste your OAUTH token here
panel = Panel("AQVX3car5qFPRLbwqTEKPUAq7g9IwlnY_hBfB2PoommmMjygRcl5BWvv_n13rZ0JEx5a8sgD7m_TAodbwuPobmdGzLsRkg-5oCoQ8Fskuj02Dp4xIYIkx7M-fHRB2UEJJw7dVEmnUfOLelr-rWwK8ekZ7ITuw0gFZlLYOTLG3VYdgUvzcSVqJP-tTqLPz17DxvDt_YkgihOv5bv9fgrtokSMntbBpaCs_iHWysk9I4RRhG0TYOw3IZDLsa3EUw54xvM3xPHS_fhcaL_8jpsoqPaxjMY0s0pQf1mVQr1pulOmONL1UTumRzepX4by140Bn8WZcEq1isNoRJnna1D7KdUbYAj18Q")
get_linkedin_id = Python3Script(oauth_token=panel, trigger=Toggle(False))  # -> api_response, linkedin_id; inputs oauth_token: String
# ---------- get_linkedin_id: Python ----------
"""GET_linkedin_id
    inputs:
        oauth_token: you can generate your oauth token usuing the linkedin developer api
        trigger: a boolean toggle
    outputs:
        api_response: prints the entire api response 
        linkedin_id: prints only the id from the api response"""

# requirements: requests

import requests

def get_linkedin_response(oauth_token, trigger):
    if not trigger:
        return "Waiting for trigger...", None

    url = "https://api.linkedin.com/v2/userinfo"
    headers = {
        "Authorization": "Bearer " + oauth_token # authentication
    }

    response = requests.get(url, headers=headers)
    
    # get api response
    api_response = response.text
    
    # extract linkedin id (sub)
    response_data = response.json()
    linkedin_id = response_data.get("sub", "No ID found")
    
    return api_response, linkedin_id # return response and id

# outputs
api_response, linkedin_id = get_linkedin_response(oauth_token, trigger)
# ---------- end get_linkedin_id ----------
post_share_linkedin = Python3Script(
    linkedin_id=get_linkedin_id.linkedin_id,
    oauth_token=panel,
    post_content="This post was done using Grasshopper.",
    trigger=Toggle(False))  # -> api_response; inputs oauth_token: String
# ---------- post_share_linkedin: Python ----------
"""POST_share_linkedin
    inputs:
        linkedin_id: the id output from the previous get request
        oauth_token: same token as the get request
        post_content: whatever you want to post (should be a string)
        trigger: a boolean toggle
    outputs:
        api_response: prints the entire api response"""

# requirements: requests

import requests
import json

def post_linkedin_update(linkedin_id, oauth_token, post_content, trigger):
    if not trigger:
        return "Waiting for trigger..."

    url = "https://api.linkedin.com/v2/ugcPosts"
    headers = {
        "Authorization": "Bearer " + oauth_token,
        "Content-Type": "application/json"
    }

    # Ensure the linkedin_id is correctly formatted as a URN
    linkedin_id = "urn:li:person:" + linkedin_id

    # Create the JSON payload
    payload = {
        "author": linkedin_id,
        "lifecycleState": "PUBLISHED",
        "specificContent": {
            "com.linkedin.ugc.ShareContent": {
                "shareCommentary": {
                    "text": post_content
                },
                "shareMediaCategory": "NONE"
            }
        },
        "visibility": {
            "com.linkedin.ugc.MemberNetworkVisibility": "PUBLIC"
        }
    }

    # Send the POST request
    response = requests.post(url, headers=headers, data=json.dumps(payload))
    
    # Return the response text
    return response.text

# Outputs
api_response = post_linkedin_update(linkedin_id, oauth_token, post_content, trigger)
# ---------- end post_share_linkedin ----------
panel_2 = Panel(get_linkedin_id.api_response)
panel_3 = Panel(get_linkedin_id.linkedin_id)
panel_4 = Panel(post_share_linkedin)
